# Grasshopper definition Examples.gh (Grasshopper 1.0.7)
# plug-ins: MyComponents

number_slider = Slider(7, range=0..7)
range = Range(Domain=number_slider, Steps=number_slider)
pop3d = Populate3D(Region={Plane=PlaneXY(0, 0, 0), X=Domain(0, 10), Y=Domain(0, 10), Z=Domain(0, 2)}, Count=100, Seed=1)
list_item = ListItem(List=pop3d, Index=range, Wrap=True)
sequentialpointsorter = SequentialPointSorter(Points=list_item)
intcrv = Interpolate(Vertices=sequentialpointsorter, Degree=3, Periodic=False, KnotStyle=1)  # -> Curve, Length, Domain
patch = Patch(Points=pop3d, Spans=20, Flexibility=1, Trim=True)
crv = Curve(intcrv.Curve)
srf = Surface(patch)
sc = SmoothCurveOnSurface(Curve=crv, Srf=srf, Strength=Slider(0.428, range=0..1), Iterations=Slider(20, range=0..100))

# ---- group: Smooth Curve
crv_2 = Curve(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)
cs = CurveSmooth(Curve=crv_2, Factor=Slider(0.015, range=0..0.015), Iterations=Slider(12, range=0..100))
crv_3 = Curve(cs)

# ----
crv_4 = Curve(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)
splitty = AngleThresholdCurveExplode(PolyCurve=crv_4, Angle=Slider(0.12, range=0..0.6))
curvepoint = PointOnCurve(splitty, parameter=1)

crv_5 = Curve([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])
flippy = SequentialCurveFlipper(Curve=crv_5)
curvepoint_2 = PointOnCurve(flippy, parameter=1)

crv_6 = Curve(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)
crv_7 = Curve(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)
angle = CurveSmallestAngle(Line1=crv_6, Line2=crv_7)
panel = Panel(angle)

crv_8 = Curve(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)
nickname = PolycurveAngleFinder(Polycurve=crv_8)  # -> InternalSupliment, ExternalSupliment
panel_2 = Panel(nickname.InternalSupliment)
panel_3 = Panel(nickname.ExternalSupliment)

# ---- group: view origional lines orientation
curvepoint_3 = PointOnCurve(crv_5, parameter=0)

# ----
xy = XYPlane(Origin=Point(0, 0, 0))
X = Get_X(Plane=xy)
panel_4 = Panel(X)

xy_2 = XYPlane(Origin=Point(0, 0, 0))
Y = Get_Y(Plane=xy_2)
panel_5 = Panel(Y)

xy_3 = XYPlane(Origin=Point(0, 0, 0))
zzz = Get_Z(Plane=xy_3)
panel_6 = Panel(zzz)

crv_9 = Curve(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)
cp = PolycurveKinkBysectorPlane(Polycurve=crv_9)  # -> MyCurve, Bisectors
crv_10 = Curve(cp.MyCurve)
pln = Plane(cp.Bisectors)

# ---- group: View origional planes
pln_2 = Plane([Plane(origin=(9.714765293, -5.820046531, -8.319229622), x=(0.3575384312, -0.7907554452, -0.4968622506), y=(-0.7670794726, -0.5521251341, 0.3267214702)), Plane(origin=(11.24057075, -6.564110364, -6.202563422), x=(0.5451177901, 0.8308566776, -0.1119096784), y=(-0.597262606, 0.4785512084, 0.6436350833)), Plane(origin=(12.90917511, -7.370831799, -4.183115274), x=(0.7782939481, 0.2966878024, -0.5533849278), y=(-0.04418765816, 0.9050212578, 0.4230649759)), Plane(origin=(14.65880605, -8.236367757, -2.264588494), x=(0.6517778367, -0.2234043444, -0.7247593742), y=(-0.3910128666, -0.9178157413, -0.0687255635)), Plane(origin=(16.42769125, -9.156875161, -0.4506863989), x=(0.7385323068, 0.1484606023, -0.6576697358), y=(0.1357257444, 0.9227486367, 0.3607124558)), Plane(origin=(18.15405839, -10.12851093, 1.254887693), x=(0.69159217, 0.6508626022, -0.3131743019), y=(-0.2977357283, 0.6519265575, 0.6973845422))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])

# ----
flipme = SequentialPlaneFlipper(Planes=pln_2)
pln_3 = Plane(flipme)

pt = Point([Point(4.30938588, -44.56118892, 0), Point(16.95306401, -48.68867516, 0), Point(14.44709707, -47.65662445, 0), Point(9.964808743, -45.84025416, 0), Point(26.41257789, -59.88099589, 0), Point(18.29452665, -69.33755798, 0)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])
sort = SequentialPointSorter(Points=pt)
pline = PolyLine(Vertices=sort, Closed=False)

# ---- group: View origional polyline
pline_2 = PolyLine(Vertices=pt, Closed=False)

# ---- group: smooth surface
pop3d_2 = Populate3D(Region={Plane=PlaneXY(0, 0, 0), X=Domain(0, 10), Y=Domain(0, 10), Z=Domain(0, 2)}, Count=100, Seed=1)
patch_2 = Patch(Points=pop3d_2, Spans=20, Flexibility=1, Trim=True)
smooth = SurfaceSmooth(Surface=patch_2, Strength=Slider(0.071, range=0..1), Iterations=Slider(248, range=0..1000), Fixed=Toggle(False))
sdivide = DivideSurface(Surface=smooth, UCount=10, VCount=10)  # -> Points, Normals, Parameters
intcrv_2 = Interpolate(Vertices=sdivide.Points, Degree=3, Periodic=False, KnotStyle=1)  # -> Curve, Length, Domain
