# Grasshopper definition unnamed.gh (Grasshopper 1.0.7)
# plug-ins: MyComponents

number_slider = Slider(86, range=0..100)
toggle = BooleanToggle(True)
crv = Curve(<curve referenced from the Rhino model>)
xy = XYPlane(Origin=Point(0, 0, 0))
number_slider_2 = Slider(6.5, range=0..10)
number_slider_3 = Slider(0, range=0..10000)
cs = CurveSmooth(Curve=crv, Factor=Slider(0.28, range=0..1))
cp = ControlPoints(Curve=cs)  # -> Points, Weights, Knots
cs_2 = CurveSmooth(Curve=crv, Factor=Slider(0.438, range=0..1))
